# Grasshopper definition test-hops.gh (Grasshopper 1.0.7)
# plug-ins: Hops

pt = Point(Tree({5}: [Point(-55.24888338, -1235.705689, 0)], {50}: [Point(-55.24888338, -1248.000848, 0)]))
crv = Curve(Tree({5}: [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], {50}: [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]))
hops = Hops(
    Corner_pts=pt,
    Edges=crv,
    CacheResultsInMemory=True,
    CacheSolveResults=True,
    RemoteDefinitionLocation="http://localhost:5000/test",
    RemoteSolveVersion=(0, 1, 0),
    ShowInput_Enabled=False,
    ShowInput_Path=False,
    SynchronousSolve=True)  # -> Test1, Test2
data = Data(hops.Test1)
data_2 = Data(hops.Test2)
